# Grasshopper definition gh-graph-ml.gh (Grasshopper 1.0.8)

number_slider = Slider(1, range=0..10)
number_slider_2 = Slider(2, range=0..10)
negative = Negative(Value=number_slider)
negative_2 = Negative(Value=number_slider_2)
construct_domain = ConstructDomain(DomainStart=negative, DomainEnd=number_slider)
construct_domain_2 = ConstructDomain(DomainStart=negative_2, DomainEnd=number_slider_2)
rectangle = Rectangle(Plane=PlaneXY(0, 0, 0), XSize=construct_domain, YSize=construct_domain_2, Radius=0)  # -> Rectangle, Length
unit_x = UnitX(Factor=construct_domain)
move = Move(Geometry=rectangle.Rectangle, Motion=unit_x)  # -> Geometry, Transform
number_slider_3 = Slider(1, range=0..1)
box_rectangle = BoxRectangle(Rectangle=rectangle.Rectangle, Height=number_slider_3)
box_rectangle_2 = BoxRectangle(Rectangle=move.Geometry, Height=Slider(2, range=0..10))
unit_z = UnitZ(Factor=number_slider_3)
move_2 = Move(Geometry=box_rectangle, Motion=unit_z)  # -> Geometry, Transform
